# Grasshopper definition metro.gh (Grasshopper 1.0.7)
# plug-ins: LunchBox

file_path = FilePath("C:\Users\bot\projects\munich_new_metro_pbd\data\munich.csv")
read_file = ReadFile(File=file_path, PerLineParse=True)
read_file_2 = ReadFile(File="C:\Users\bot\projects\munich_new_metro_pbd\data\mvv_stations.csv", PerLineParse=True)
read_csv = ReadCSV(CSVString=read_file, Delimiter=";")  # -> Headers, Values
panel = Panel(read_csv.Values)
read_csv_2 = ReadCSV(CSVString=read_file_2, Delimiter=";")  # -> Headers, Values
panel_2 = Panel(read_csv.Headers)
panel_3 = Panel(read_csv_2.Headers)
explode_tree = ExplodeTree(Data=read_csv_2.Values)  # -> Branch0, Branch1, Branch2, Branch3, Branch4, Branch5, Branch6, Branch7, Branch8, Branch9
explode_tree_2 = ExplodeTree(Data=read_csv.Values)  # -> Branch0, Branch1, Branch2, Branch3, Branch4, Branch5
panel_4 = Panel(explode_tree_2.Branch0)
parse_comma_double = CSharpScript(x=explode_tree.Branch8)  # -> out, A; inputs x: String
# ---------- parse_comma_double: C# ----------
    if(x == ""){
      A = null;
    }else{
      A = Double.Parse(x.Replace(',', '.'));
    }
# ---------- end parse_comma_double ----------
text = Text("München")
panel_5 = Panel(explode_tree_2.Branch2)
panel_6 = Panel(explode_tree_2.Branch5)
text_compare = CSharpScript(x=explode_tree.Branch3, y=text)  # -> out, A; inputs x: String, y: String
# ---------- text_compare: C# usings ----------
using System.Text;
# ---------- text_compare: C# ----------
    //Print(Encoding.ASCII.GetString(Encoding.ASCII.GetBytes(x.Trim())));
    //Print(y.Trim());

    A = Encoding.ASCII.GetString(Encoding.ASCII.GetBytes(x.Trim())) == Encoding.ASCII.GetString(Encoding.ASCII.GetBytes(y.Trim()));
# ---------- end text_compare ----------
parse_comma_double_2 = CSharpScript(x=explode_tree.Branch9)  # -> out, A; inputs x: String; same code as parse_comma_double
panel_7 = Panel(explode_tree.Branch3)
panel_8 = Panel(explode_tree_2.Branch1)
dispatch = Dispatch(List=parse_comma_double.A, DispatchPattern=text_compare.A)  # -> ListA, ListB
panel_9 = Panel(parse_comma_double_2.A)
dispatch_2 = Dispatch(List=parse_comma_double_2.A, DispatchPattern=text_compare.A)  # -> ListA, ListB
parse_polygon = CSharpScript(x=explode_tree_2.Branch2)  # -> out, A; inputs x: String
# ---------- parse_polygon: C# ----------
    var outList = new List<Point3d>();
    var cleanString = x.Substring(10, x.Length - 2 - 10);
    var textCoords = cleanString.Split(',');
    foreach (string textCoord in textCoords){
      var coords = textCoord.Trim().Split(' ');
      Print(textCoord);
      Print(coords.Length.ToString());
      Print("-------");
      outList.Add(new Point3d(double.Parse(coords[1]), double.Parse(coords[0]), 0));
    }
    A = outList;
# ---------- end parse_polygon ----------
panel_10 = Panel(parse_polygon.out)
number_slider = Slider(0.016, range=0..1)
construct_point = ConstructPoint(XCoordinate=dispatch.ListA, YCoordinate=dispatch_2.ListA, ZCoordinate=expr("0", 0))
panel_11 = Panel(parse_polygon.A)
multiplication = Multiplication(A=number_slider, B=explode_tree_2.Branch5)
division = Division(A=multiplication, B=Slider(23766, range=1..100000))
polyline = PolyLine(Vertices=parse_polygon.A, Closed=True)
unit_z = UnitZ(Factor=number_slider)
unit_z_2 = UnitZ(Factor=division)
boundary_surfaces = BoundarySurfaces(Edges=polyline)  # -> flatten(Surfaces)

# ---- group: Density
area = Area(Geometry=boundary_surfaces)  # -> Area, Centroid
panel_12 = Panel(area.Area)
division_2 = Division(A=explode_tree_2.Branch5, B=area.Area)

# ----
extrude = Extrude(Base=boundary_surfaces, Direction=unit_z_2)
bounds = Bounds(Numbers=division_2)
deconstruct_domain = DeconstructDomain(Domain=bounds)  # -> Start, End
gradient = Gradient(
    LowerLimit=deconstruct_domain.Start,
    UpperLimit=deconstruct_domain.End,
    Parameter=division_2,
    stops=[0: RGB(0, 128, 0), 0.5: RGB(255, 255, 0), 1: RGB(255, 0, 0)])
custom_preview = CustomPreview(Geometry=extrude, Material=gradient)
